# Dynamo graph Simlulate_CAD_texts.dyn (Dynamo 2.10.0.3455)

file_path = Filename("..\Extract_Text_data - Copy.xlsx")
file_from_path = FileObject(path=file_path)
string = StringInput("Sheet Name")
boolean = BoolSelector(true)
boolean_2 = BoolSelector(false)
importExcel = Data.ImportExcel(file=file_from_path, sheetName=string, readAsStrings=boolean, showExcel=boolean_2)
watch = Watch(importExcel)
python_script = Python(IN[0]=importExcel)  # IronPython2
# ---------- python_script.python (29 lines) ----------
# Load the Python Standard and DesignScript Libraries
import sys
import clr
clr.AddReference('ProtoGeometry')
from Autodesk.DesignScript.Geometry import *

# The inputs to this node will be stored as a list in the IN variables.
dataEnteringNode = IN
data = IN[0]
dic_ = {}
points = []
lines = []
origin = Point.ByCoordinates(0,0)

for d in data[1:]:
	try:
		x = float(d[3])
		y = float(d[4])
		pt = Point.ByCoordinates(x,y)
		points.append(pt)
		lines.append(Line.ByStartPointEndPoint(origin,pt))
	except:
		pass
	
	
# Place your code below this line

# Assign your output to the OUT variable.
OUT = points,lines
# ----------------------------------------
